# Grasshopper definition Radiation_v2.gh (Grasshopper 1.0.7)
# plug-ins: Writer

number_slider = Slider(141, range=0..1000)
number_slider_2 = Slider(104, range=0..1000)
number_slider_3 = Slider(64, range=0..1000)
number_slider_4 = Slider(101, range=0..1000)
number_slider_5 = Slider(28, range=0..100)
rectangle = Rectangle(Plane=PlaneXY(0, 0, 0), XSize=number_slider_2, YSize=number_slider, Radius=0)  # -> Rectangle, Length
area = Area(Geometry=rectangle.Rectangle)  # -> Area, Centroid
pt = Point(area.Centroid)
ladybug = Ladybug_Ladybug()  # -> Vviiiiiiiiiizzz; plug-in component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
box = DomainBox(Base=PlaneXY(0, 0, 0), X=number_slider_2, Y=number_slider, Z=number_slider_5)
vec = VectorXYZ(XComponent=expr("x/-2", number_slider_3), YComponent=expr("x/-2", number_slider_4), ZComponent=0)  # -> Vector, Length
box_2 = DomainBox(Base=area.Centroid, X=number_slider_3, Y=number_slider_4, Z=number_slider_5)
number_slider_6 = Slider(5, range=0..10)
number_slider_7 = Slider(5, range=0..10)
move = Move(Geometry=box_2, Motion=vec.Vector)  # -> Geometry, Transform
open_weather_file = Ladybug_OpenEPWWeatherFile(open=Toggle(True))  # -> epwFile; plug-in component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
sdiff = SolidDifference(BrepsA=box, BrepsB=move.Geometry)
vec_2 = VectorXYZ(XComponent=Slider(12.5, range=-8.5..12.5), YComponent=Slider(-30, range=-30..8.5), ZComponent=0)  # -> Vector, Length
box_3 = DomainBox(Base=pt, X=number_slider_6, Y=number_slider_6, Z=Slider(45, range=0..100))
vec_3 = VectorXYZ(XComponent=Slider(-8.5, range=-8.5..12.5), YComponent=Slider(-30, range=-30..8.5), ZComponent=0)  # -> Vector, Length
box_4 = DomainBox(Base=pt, X=number_slider_7, Y=number_slider_7, Z=Slider(45, range=0..100))
move_2 = Move(Geometry=box_4, Motion=vec_3.Vector)  # -> Geometry, Transform
gencumulativeskymtx = Ladybug_GenCumulativeSkyMtx(epwFile=open_weather_file, skyDensity=0, useOldRes=True, runIt=Toggle(True))  # -> readMe, cumulativeSkyMtx; plug-in component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
analysisperiod = Ladybug_AnalysisPeriod()  # -> readMe, analysisPeriod; plug-in component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
move_3 = Move(Geometry=box_3, Motion=vec_2.Vector)  # -> Geometry, Transform
debrep = DeconstructBrep(Brep=[move_3.Geometry, move_2.Geometry])  # -> Faces, Edges, Vertices
selectskymtx = Ladybug_selectSkyMtx(
    cumulativeSkyMtx=gencumulativeskymtx.cumulativeSkyMtx,
    analysisPeriod=analysisperiod.analysisPeriod,
    removeDiffuse=Toggle(False),
    removeDirect=False)  # -> readMe, selectedSkyMtx; plug-in component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
pt_2 = ConstructPoint(XCoordinate="10", YCoordinate="4.2", ZCoordinate=0)
pt_3 = ConstructPoint(XCoordinate=0, YCoordinate=0, ZCoordinate=0)
orientationstudypar = Ladybug_OrientationStudyParameters(divisionAngle=Slider(8, range=0..10), totalAngle=Slider(360, range=0..1000), basePoint=pt, runTheStudy=Toggle(False))  # -> orientationStudyPar; plug-in component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
item = ListItem(List=debrep.Faces, Index=Slider(5, range=0..10), Wrap=True)
ln = Line(StartPoint=pt_3, EndPoint=pt_2)
brep = Brep(flatten([move_3.Geometry, move_2.Geometry]))
brep_2 = Brep(flatten(item))
importepw = Ladybug_ImportEpw(epwFile=open_weather_file)  # -> readMe, latitude, location, dryBulbTemperature, dewPointTemperature, relativeHumidity, windSpeed, windDirection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; plug-in component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
vec_4 = Vector(ln)
brep_3 = Brep(flatten([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]))
series = Series(Start="1", Step=1, Count="8760")
graft = GraftTree(Tree=series, IncludeEmptyLists=True, IncludeNullItems=True)
radiationanalysis = Ladybug_RadiationAnalysis(
    north=vec_4,
    geometry=flatten(brep),
    gridSize=Slider(4, range=0..10),
    disFromBase=Slider(0.03, range=0..1),
    orientationStudyP=flatten(orientationstudypar),
    selectedSkyMtx=flatten(selectskymtx.selectedSkyMtx),
    parallel=Toggle(True),
    runIt=Toggle(False))  # -> readMe, contextMesh, analysisMesh, testPts, testVec, port, radiationResult, radiationMesh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; plug-in component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
panel = Panel(series)
panel_2 = Panel("180")
panel_3 = Panel("0")
panel_4 = Panel("90")
srfsolar = Ladybug_SurfaceHourlySolar(
    location=importepw.location,
    directNormal=importepw.directNormalRadiation,
    diffuseHorizontal=importepw.diffuseHorizontalRadiation,
    srfAzimuth="270",
    srfAltitude="0",
    skyModel=Toggle(True))  # -> readMe, srfDirect, srfDiffuse, srfTotal, srfDirection; plug-in component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
selectskymtx_2 = Ladybug_selectSkyMtx(cumulativeSkyMtx=gencumulativeskymtx.cumulativeSkyMtx, HOY=graft, removeDiffuse=False, removeDirect=False)  # -> readMe, selectedSkyMtx; plug-in component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
series_2 = Series(Start="0", Step=1, Count="7")
cull_i = CullIndex(List=srfsolar.srfTotal, Indices=series_2, Wrap=True)
panel_6 = Panel(radiationanalysis.totalRadiation)
ma = MassAddition(Input=cull_i)  # -> Result, PartialResults
rtradiationanalysis = Ladybug_RealTimeRadiationAnalysis(selectedSkyMatrix=selectskymtx_2.selectedSkyMtx, intersectionMatrix=radiationanalysis.intersectionMtx)  # -> radiationResult; plug-in component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
panel_7 = Panel(cull_i)
panel_8 = Panel(ma.Result)
ma_2 = MassAddition(Input=panel_6)  # -> Result, PartialResults
panel_9 = Panel(ma_2.Result)
panel_10 = Panel(rtradiationanalysis)
simplify = SimplifyTree(Tree=rtradiationanalysis, Front=False)
flip = FlipMatrix(Data=simplify)
item_2 = ListItem(List=flip, Index=0, Wrap=True)  # -> flatten(Item)
# C:\Users\cy960\OneDrive - Massachusetts Institute of Technology\00Research\SimulationTestbed\SolarSimulationOutput\West
writer = Writer(Data=cull_i)
lng = ListLength(List=item_2)
ma_3 = MassAddition(Input=panel_10)  # -> simplify(Result), PartialResults
area_2 = Area(Geometry=item)  # -> Area, Centroid
division = Division(A=flatten(ma_3.Result), B=lng)
ma_4 = MassAddition(Input=flatten(area_2.Area))  # -> Result, PartialResults
multiplication = Multiplication(A=division, B=ma_4.Result)
ma_5 = MassAddition(Input=flatten(multiplication))  # -> Result, PartialResults
panel_11 = Panel("D:\egascon\00_OneDrive\Massachusetts Institute of Technology\Zachary Michael Berzolla - 4421_Munich\02_Work\20200302_SolarChimney\20200505_Radiation\roof")
multiplication_2 = Multiplication(A=division, B="1000")
should_be_same_as_total_radiation = Panel(ma_5.Result)
writer_2 = Writer(Filepath=panel_11)
